% Simulink design studies sldemo_autotrans_design_study.mldatx for model sldemo_autotrans

study "DesignStudy": 4 simulations
  combinatorial set (4 points):
    "ActiveScenario": BlockParameter(BlockPath=sldemo_autotrans/ManeuversGUI, Name=ActiveScenario), values Label=Coasting, Label=Gradual_Acceleration, Label=Hard_braking, Label=Passing_Maneuver (4 points)